# Grasshopper definition tenon.gh (Grasshopper 1.0.7)
# plug-ins: ShapeDiverForGrasshopper, Kangaroo2 Components
# joints tenons generations

sddp = ShapeDiverDocumentPayload({AbsoluteTolerance=0, AngleTolerance=0, DistanceDisplayPrecision=0, GltfVersion="Gltf2", GrasshopperVersion="1.0.0007", InputGroups="{}", OutputGroups="{}", RelativeTolerance=0, RhinoVersion="7.29.23107.3001", UnitSystem=0, VersionCreated="1.14.0.0", VersionSaved="1.14.0.0"})

number_slider = Slider(1, range=1..15)
number_slider_2 = Slider(2, range=0..100)
number_slider_3 = Slider(3, range=0..100)

caps = GetNumber(AtLeast=1, AtMost=1, Maximum=1.797693135e+308, Minimum=-1.797693135e+308, TreeAccess=False)
structs = GetGeometry(AtLeast=1, AtMost=1, DeleteInput=False, Filter=1073741828, TreeAccess=False)
joints = GetGeometry(AtLeast=1, AtMost=1, DeleteInput=False, Filter=1074004000, TreeAccess=False)
structsradius = GetNumber(AtLeast=1, AtMost=1, Maximum=1.797693135e+308, Minimum=-1.797693135e+308, TreeAccess=False)
subd = SubD(joints)
equals = Equality(FirstNumber=caps, SecondNumber=0)  # -> Equality, Inequality
mp = MultiPipe(Curves=structs, NodeSize=structsradius, EndOffset=1, StrutSize=1, Segment=0, KinkAngle=0.6, CubeFit=0, Caps=caps)
gate = StreamGate(Stream=subd, Gate=equals.Inequality)  # -> Target0, Target1
edges = BrepEdges(Brep=gate.Target0)  # -> Naked, Interior, NonManifold
graft = GraftTree(Tree=gate.Target0, IncludeEmptyLists=True, IncludeNullItems=True)  # -> simplify(Tree)
boundary = BoundarySurfaces(Edges=edges.Naked)  # -> simplify(Surfaces)
depth = GetNumber(AtLeast=1, AtMost=1, Maximum=1.797693135e+308, Minimum=-1.797693135e+308, TreeAccess=False)
shift = GetNumber(AtLeast=1, AtMost=1, Maximum=1.797693135e+308, Minimum=-1.797693135e+308, TreeAccess=False)
evalsrf = EvaluateSurface(Surface=reparameterize(boundary), Point="0.5,0.5")  # -> Point, Normal, UDirection, VDirection, Frame
join = BrepJoin(Breps=[boundary, graft])  # -> Breps, Closed
amp = Amplitude(Vector=evalsrf.Normal, Amplitude=expr("-x", shift))
cyl = Cylinder(Base=evalsrf.Frame, Radius=structsradius, Length=depth)
filter = StreamFilter(Gate=0, Stream0=join.Breps)
cap = CapHoles(Brep=cyl)
move = Move(Geometry=cap, Motion=amp)  # -> Geometry, Transform
sdiff = SolidDifference(BrepsA=join.Breps, BrepsB=move.Geometry)
sdiff_2 = SolidDifference(BrepsA=gate.Target1, BrepsB=mp)
geo = Geometry([sdiff, sdiff_2])
geo_2 = Geometry(mp)
context_bake = ContextBake(Geometry=geo)
context_bake_2 = ContextBake(Geometry=geo_2)
